% Simulink data dictionary EstimatorsDictionary.sldd
% references CellDictionary.sldd

Ts = Simulink.Parameter(1)
soc_estim_init = Simulink.Parameter(0.5)
initial_covariance = Simulink.Parameter([0.2 1.0e-6 1.0e-5 0.0001])
state_covariance = Simulink.Parameter([1.0e-10 0 0 0; 0 1.0e-8 0 0; 0 0 1.0e-8 0; 0 0 0 1.0e-8])
measurement_covariance = Simulink.Parameter(0.0001)
cap_measurement_covariance = Simulink.Parameter(5.0e-7)  % Covariance of the measurement noise, R, in the capacity EKF estimator
cap_initial_covariance = Simulink.Parameter(1.0e-8)  % Initial state error covariance, P0, of the capacity EKF estimator
cap_current_measurement_variance = Simulink.Parameter(5.0e-7)  % Variance of current measurement in the least squares capacity estimator
cap_forgetting_factor = Simulink.Parameter(0.9)  % Forgetting factor, gamma, of the least squares capacity estimator
cap_soc_change_threshold = Simulink.Parameter(0.05)  % SOC change detection threshold of the least squares capacity estimator
cap_process_covariance = Simulink.Parameter(3e-06)  % Covariance of the process noise, Q, in the capacity EKF estimator