% Simulink data dictionary ParametersDataDictionary.sldd

SOC_IMBALANCE_LIMIT_VALUE = Simulink.Parameter(Simulink.data.Expression(ExpressionString="20"), StorageClass="Define", HeaderFile="BatteryParameters.h", DataType="uint16")  % Units 1000%
VOLTAGE_IMBALANCE_LIMIT_VALUE = Simulink.Parameter(Simulink.data.Expression(ExpressionString="4"), StorageClass="Define", HeaderFile="BatteryParameters.h", DataType="int32")  % Units Vx10
ERROR_CRITICAL_OPEN_MAIN_CONTACTORS_TIMEOUT_SEC = Simulink.Parameter(Simulink.data.Expression(ExpressionString="10"), StorageClass="Define", HeaderFile="BatteryParameters.h", DataType="uint16")  % Open main contactors timeout (in seconds) in case of a critical error system
CELL_OVER_TEMPERATURE_LIMIT_VALUE = Simulink.Parameter(Simulink.data.Expression(ExpressionString=" 50"), StorageClass="Define", HeaderFile="BatteryParameters.h", DataType="uint16")
SOC_MIN_LIMIT_VALUE = Simulink.Parameter(Simulink.data.Expression(ExpressionString="5"), StorageClass="Define", HeaderFile="BatteryParameters.h", DataType="uint16")
SOH_MIN_LIMIT_VALUE = Simulink.Parameter(Simulink.data.Expression(ExpressionString="5"), StorageClass="Define", HeaderFile="BatteryParameters.h", DataType="uint16")
CELL_UNDER_TEMPERATURE_LIMIT_VALUE = Simulink.Parameter(Simulink.data.Expression(ExpressionString=" 0"), StorageClass="Define", HeaderFile="BatteryParameters.h", DataType="int16")
DELTA_VOLTAGE_LIMIT_VALUE = Simulink.Parameter(Simulink.data.Expression(ExpressionString="4"), StorageClass="Define", HeaderFile="BatteryParameters.h", DataType="int32")  % Maximum (packMaxVoltage - packMinVoltage) difference value allowed
DEBOUNCE_HVIL_TIMEOUT_MS = Simulink.Parameter(Simulink.data.Expression(ExpressionString="1000"), StorageClass="Define", HeaderFile="BatteryParameters.h", DataType="uint16", Min=0, Max=10000)  % HVIL signals debouncing time
CELL_OVER_VOLTAGE_LIMIT_VALUE = Simulink.Parameter(Simulink.data.Expression(ExpressionString="4100"), StorageClass="Define", HeaderFile="BatteryParameters.h", DataType="uint16")
NP_BATTERIES = Simulink.Parameter(Simulink.data.Expression(ExpressionString="2"), StorageClass="Define", HeaderFile="BatteryParameters.h", DataType="int32", Min=1, Max=1024)  % Number of batteries connected in parallel
NS_BATTERIES = Simulink.Parameter(Simulink.data.Expression(ExpressionString="2"), StorageClass="Define", HeaderFile="BatteryParameters.h", DataType="int32", Min=1, Max=1024)  % Number of batteries connected in series
N_BATTERIES = Simulink.Parameter(Simulink.data.Expression(ExpressionString="NS_BATTERIES*NP_BATTERIES"), StorageClass="Define", HeaderFile="BatteryParameters.h", DataType="int32")
CELL_UNDER_VOLTAGE_LIMIT_VALUE = Simulink.Parameter(Simulink.data.Expression(ExpressionString="3100"), StorageClass="Define", HeaderFile="BatteryParameters.h", DataType="uint16")
TRA_PRESSURE_LIMIT_VALUE = Simulink.Parameter(Simulink.data.Expression(ExpressionString="120"), StorageClass="Define", HeaderFile="BatteryParameters.h", DataType="int32")  % Value in KPa
TRA_TEMPERATURE_LIMIT_VALUE = Simulink.Parameter(Simulink.data.Expression(ExpressionString="100"), StorageClass="Define", HeaderFile="BatteryParameters.h", DataType="int32")  % value in ºC
TRA_CO2_LIMIT_VALUE = Simulink.Parameter(Simulink.data.Expression(ExpressionString="5000"), StorageClass="Define", HeaderFile="BatteryParameters.h", DataType="int32")  % value in ppm
TRA_CO_LIMIT_VALUE = Simulink.Parameter(Simulink.data.Expression(ExpressionString="1000"), StorageClass="Define", HeaderFile="BatteryParameters.h", DataType="int32")  % value in ppm
SHUTDOWN_TIMEOUT_LIMIT_VALUE_MS = Simulink.Parameter(Simulink.data.Expression(ExpressionString="5000"), StorageClass="Define", HeaderFile="BatteryParameters.h", DataType="int32")  % Time in ms to perform shutdown secuence before timeout error reached
SOC_MAX_LIMIT_VALUE = Simulink.Parameter(Simulink.data.Expression(ExpressionString="1000"), StorageClass="Define", HeaderFile="BatteryParameters.h", DataType="int32")
RACK_OVER_VOLTAGE_LIMIT_VALUE = Simulink.Parameter(Simulink.data.Expression(ExpressionString="950"), StorageClass="Define", HeaderFile="BatteryParameters.h", DataType="int32")
RACK_UNDER_VOLTAGE_LIMIT_VALUE = Simulink.Parameter(Simulink.data.Expression(ExpressionString="700"), StorageClass="Define", HeaderFile="BatteryParameters.h", DataType="int32")
RACK_OVER_TEMPERATURE_LIMIT_VALUE = Simulink.Parameter(Simulink.data.Expression(ExpressionString="55"), StorageClass="Define", HeaderFile="BatteryParameters.h", DataType="int32")
RACK_UNDER_TEMPERATURE_LIMIT_VALUE = Simulink.Parameter(Simulink.data.Expression(ExpressionString="-20"), StorageClass="Define", HeaderFile="BatteryParameters.h", DataType="int32")
CURRENT_CHARGE_OFF_VALUE = Simulink.Parameter(Simulink.data.Expression(ExpressionString="19"), StorageClass="Define", HeaderFile="BatteryParameters.h", DataType="int32")
HV_PACK_MIN_LIMIT_VALUE = Simulink.Parameter(Simulink.data.Expression(ExpressionString="67"), StorageClass="Define", HeaderFile="BatteryParameters.h", DataType="int32")
CHARGE_ON_TIMEOUT_LIMIT_VALUE_MS = Simulink.Parameter(Simulink.data.Expression(ExpressionString="10000"), StorageClass="Define", HeaderFile="BatteryParameters.h", DataType="int32")
CAN1_ALIVE_TIMEOUT_LIMIT_VALUE_MS = Simulink.Parameter(Simulink.data.Expression(ExpressionString="2000"), StorageClass="Define", HeaderFile="BatteryParameters.h", DataType="int32")
OPEN_K_MAIN_TIMEOUT_LIMIT_VALUE_MS = Simulink.Parameter(Simulink.data.Expression(ExpressionString="10000"), StorageClass="Define", HeaderFile="BatteryParameters.h", DataType="int32")
ZERO_CURRENT_TO_SHUTDOWN = Simulink.Parameter(Simulink.data.Expression(ExpressionString="10"), StorageClass="Define", HeaderFile="BatteryParameters.h", DataType="int32")  % Maximum absolute current value allowed to start the shutdown
ZERO_CURRENT_TO_PRECHARGE = Simulink.Parameter(Simulink.data.Expression(ExpressionString="10"), StorageClass="Define", HeaderFile="BatteryParameters.h", DataType="int32")  % Maximum absolute current value allowed to start the precharge
ZERO_CURRENT_CHARGE = Simulink.Parameter(Simulink.data.Expression(ExpressionString="10"), StorageClass="Define", HeaderFile="BatteryParameters.h", DataType="int32")
N_CSC_MODULES = Simulink.Parameter(Simulink.data.Expression(ExpressionString="2"), StorageClass="Define", HeaderFile="BatteryParameters.h", DataType="int32", Min=1, Max=255)  % Number of Cell Supervisor Circuits modules installed
N_CELL_TEMPERATURE = Simulink.Parameter(Simulink.data.Expression(ExpressionString="2"), StorageClass="Define", HeaderFile="BatteryParameters.h", DataType="int32", Min=1, Max=255)  % Number of temperature sensor in a CSC module
DEM_MAX_CODES = Simulink.Parameter(Simulink.data.Expression(ExpressionString="64"), StorageClass="Define", HeaderFile="BatteryParameters.h", DataType="int32", Min=1, Max=1023)
BAL_START_VOLTAGE_MV = Simulink.Parameter(Simulink.data.Expression(ExpressionString="3500"), StorageClass="Define", HeaderFile="BatteryParameters.h", DataType="int32", Min=2500, Max=4500)
BAL_HYSTERESIS_VOLTAGE_MV = Simulink.Parameter(Simulink.data.Expression(ExpressionString="30"), StorageClass="Define", HeaderFile="BatteryParameters.h", DataType="int32", Min=1, Max=100)
BAL_BALANCE_WINDOWS_MV = Simulink.Parameter(Simulink.data.Expression(ExpressionString="30"), StorageClass="Define", HeaderFile="BatteryParameters.h", DataType="int32", Min=1, Max=200)
ZERO_CURRENT_TO_OPEN = Simulink.Parameter(Simulink.data.Expression(ExpressionString="10"), StorageClass="Define", HeaderFile="BatteryParameters.h", DataType="int32")  % Maximum absolute current value in Amps  allowed to open contactors
ZERO_CURRENT_TO_CLOSE = Simulink.Parameter(Simulink.data.Expression(ExpressionString="10"), StorageClass="Define", HeaderFile="BatteryParameters.h", DataType="int32")  % Maximum absolute current value in Amps  allowed to close contactors
BAL_STOP_THRESHOLD_MV = Simulink.Parameter(Simulink.data.Expression(ExpressionString="5"), StorageClass="Define", HeaderFile="BatteryParameters.h", DataType="int32")
ZERO_CURRENT_TO_CHARGE = Simulink.Parameter(Simulink.data.Expression(ExpressionString="20"), StorageClass="Define", HeaderFile="BatteryParameters.h", DataType="int32")
PRECHARGE_TIMEOUT_MS = Simulink.Parameter(Simulink.data.Expression(ExpressionString="2000"), StorageClass="Define", HeaderFile="BatteryParameters.h", DataType="int32")  % Time in ms to perform precharge secuence before timeout error reached
COIL_COOLING_TIME_MS = Simulink.Parameter(Simulink.data.Expression(ExpressionString="1000"), StorageClass="Define", HeaderFile="BatteryParameters.h", DataType="int32")
RETRY_ATTEMPTS_LIMIT_VALUE = Simulink.Parameter(Simulink.data.Expression(ExpressionString="3"), StorageClass="Define", HeaderFile="BatteryParameters.h", DataType="int32")
CHARGE_CONSTANT_CURRENT = Simulink.Parameter(Simulink.data.Expression(ExpressionString=" 5000"), StorageClass="Define", HeaderFile="BatteryParameters.h", DataType="int32")  % value en milliamps
CHARGE_CELL_VOLTAGE_TARGET = Simulink.Parameter(Simulink.data.Expression(ExpressionString="4150"), StorageClass="Define", HeaderFile="BatteryParameters.h", DataType="int32")  % value in millivolts
CHARGE_CC_MODE_CELL_VOLTAGE_TARGET = Simulink.Parameter(Simulink.data.Expression(ExpressionString="3900"), StorageClass="Define", HeaderFile="BatteryParameters.h", DataType="int32")  % value in millivolts
CHARGE_CURRENT_DEAD_BAND = Simulink.Parameter(Simulink.data.Expression(ExpressionString="1000"), StorageClass="Define", HeaderFile="BatteryParameters.h", DataType="int32")  % value in milliamps
CHARGE_GAIN_CURRENT_CV_MODE = Simulink.Parameter(Simulink.data.Expression(ExpressionString="1.0"), StorageClass="Define", HeaderFile="BatteryParameters.h", DataType="single")
BATTERY_CAPACITY_AH = Simulink.Parameter(Simulink.data.Expression(ExpressionString="NP_BATTERIES*BATERY_MODULE_CAPACITY_AH"), StorageClass="Define", HeaderFile="BatteryParameters.h", DataType="uint32", Min=0, Max=5000)
SOX_Ts = Simulink.Parameter(1, DataType="double")
BATTERY_MODULE_CAPACITY_AH = Simulink.Parameter(51, StorageClass="Define", HeaderFile="BatteryParameters.h", DataType="single", Min=0, Max=1000)
N_CELL_VOLTAGE = Simulink.Parameter(Simulink.data.Expression(ExpressionString="12"), StorageClass="Define", HeaderFile="BatteryParameters.h", DataType="int32", Min=1, Max=255)  % Number of cell voltages in a Cell Supervisor Module
SOC_ESTIM_INIT = Simulink.Parameter(0.5, DataType="single")
SOC_STATE_COVARIANCE = Simulink.Parameter([1.0e-7 0 0 0; 0 1.0e-6 0 0; 0 0 1.0e-5 0; 0 0 0 1.0e-5], DataType="single")  % Q
SOC_INITIAL_COVARIANCE = Simulink.Parameter([0.1 0 0 0; 0 0.0001 0 0; 0 0 0.001 0; 0 0 0 0.001], DataType="single")  % P0
SOC_MEASUREMENT_COVARIANCE = Simulink.Parameter(0.01, DataType="single")  % R

OCV_V = Simulink.Parameter([3.426 3.426
 3.511 3.511
 3.595 3.595
 3.627 3.627
 3.656 3.656
 3.705 3.705
 3.785 3.785
 3.893 3.893
 3.955 3.955
 4.054 4.054
 4.178 4.178], DataType="single")

OCV_T = Simulink.Parameter([25 35], DataType="single")
OCV_SOC = Simulink.Parameter([0 0.1 0.2 0.3 0.4 0.5 0.6 0.7 0.8 0.9 1], DataType="single")

dOCV_dSOC = Simulink.Parameter([0.85 0.85
 0.845 0.845
 0.58 0.58
 0.305 0.305
 0.39 0.39
 0.645 0.645
 0.94 0.94
 0.85 0.85
 0.805 0.805
 1.115 1.115
 1.24 1.24], DataType="single")

ECM_C1_C = Simulink.Parameter([5154 5282 6022 6094 4616 5313 8639 6626 9337 9338 6039 6046 6354 6987 7073 6628 6633 7009 6461 5597 5595
 7026 6834 5723 5723 11831 9929 11887 7280 7280 6268 6263 6328 6473 6000 6215 22192 18503 19619 19619 8765 8765
 9772 13304 19827 6902 6902 17487 9132 9137 11758 11758 20048 12260 18161 9292 9225 8637 10259 10332 9339 9343 10286
 9147 9147 8949 8949 13350 13353 11502 5520 5511 9195 9182 8896 9934 1545 2040 8357 8183 8184 9682 11179 11179], DataType="single")

ECM_C1_D = Simulink.Parameter([3228 5811 8135 9961 9960 8460 8460 7834 6541 8123 6442 5988 4643 4456 6230 6824 6824 8391 7219 7216 5088
 2948 4127 4952 5636 9207 9396 9395 10153 18964 12313 12210 9558 5518 5518 8788 6569 6566 12136 12136 5547 5547
 5233 6804 8164 7911 8366 12773 12772 5968 9267 8367 8366 8077 7691 5995 6089 7128 6850 6850 13839 8646 7918
 5436 6524 7176 9532 9401 9959 9964 9123 8525 3742 3428 8045 8540 7286 7192 8683 9240 9235 15910 15909 9936], DataType="single")

ECM_C2_C = Simulink.Parameter([45772 42175 36169 41340 47524 48850 45431 42984 41064 43682 43541 39789 45918 48477 55263 64838 90401 93647 97781 53097 50682
 48984 48984 43595 50607 55037 56691 56140 53070 47628 51420 54115 52300 49782 53143 92898 146159 119611 105582 143250 122372 109386
 24783 32749 52239 59483 72508 70550 67393 60478 50122 49145 46983 51134 68608 80888 82285 199259 212757 201844 199124 87316 81848
 56515 56515 56744 68212 78331 78064 82065 69996 54978 51819 51110 66238 72758 71634 73038 293176 259437 224964 153522 77891 74498], DataType="single")

ECM_C2_D = Simulink.Parameter([4760 14279 28557 50490 59702 61545 55391 53021 50650 50050 38012 30401 33602 34859 36151 39720 39627 40550 46694 49095 49048
 6966 20899 37618 57647 68813 79350 86528 84807 71191 57961 52076 39369 41072 47754 48059 49258 54948 58990 56826 49712 57134
 42821 68514 95920 73073 73222 86184 88192 92745 71040 70293 50396 50234 66892 60650 57065 74722 70704 74358 89402 85501 79759
 29934 47895 57474 66990 80296 82074 86426 83396 80634 48270 43580 78082 72578 71267 75511 85818 84616 110692 141145 132638 132638], DataType="single")

ECM_C3_C = Simulink.Parameter([537058 541039 547828 839223 1000602 1184548 1028380 745536 620308 446818 342589 314136 1190741 997334 849167 882848 1016364 771200 528828 268751 261411
 589124 568254 680683 1607216 1251630 1483067 1436146 1168882 824195 641457 573506 2321473 1692571 1517925 1420883 1467693 1346419 333390 271042 622864 621729
 714633 686461 941505 3290233 3006278 3218937 2223746 1688371 1301261 922723 721977 973384 2323782 1910459 1876484 2346490 2391553 772044 712688 129062 128979
 1204481 1730326 2378176 3006282 3472896 3636270 3355757 2653844 2084020 1739693 1659558 3276731 3302925 2741269 2752263 2758545 1686074 968004 379883 523784 597358], DataType="single")

ECM_C3_D = Simulink.Parameter([580 5803 58029 550952 473354 437563 497163 517884 793531 1010883 1066704 560490 286493 262704 264762 316562 473717 632561 1273274 1582393 1582393
 7054 35269 176346 1077867 778552 643625 691708 785936 1122645 1344004 1433795 1156714 304817 307371 354726 678950 1111945 1477434 1799765 1994996 2055424
 520703 1041407 1562110 377705 1457119 1059730 1156803 1130538 1385533 1961793 2759419 604609 426225 428532 610435 2322827 2463971 2643408 3294845 3154237 2876517
 278880 501983 702777 1289111 719377 698669 970788 1035732 1849087 2516467 3406884 5276303 598334 647146 2088109 3035769 2837983 2946828 3625145 3618568 3618568], DataType="single")

ECM_R0_C = Simulink.Parameter([0.00214 0.0019 0.00188 0.00186 0.00184 0.00185 0.00182 0.00179 0.0018 0.00175 0.00174 0.00176 0.00173 0.00168 0.00171 0.00172 0.00169 0.00168 0.00174 0.00177 0.00181
 0.0015 0.00131 0.00129 0.00126 0.00122 0.0012 0.00119 0.00118 0.00119 0.00118 0.00117 0.00116 0.00116 0.00117 0.00116 0.00114 0.00118 0.00118 0.00122 0.00125 0.00127
 0.00096 0.00093 0.00088 0.00088 0.00087 0.00085 0.00083 0.00083 0.00083 0.00086 0.00083 0.00082 0.00083 0.00082 0.00082 0.00082 0.00082 0.00082 0.00085 0.00086 0.00088
 0.00066 0.00065 0.00064 0.00063 0.00062 0.00061 0.00061 0.0006 0.0006 0.00061 0.0006 0.00059 0.00059 0.00059 0.00059 0.00059 0.00059 0.00059 0.00061 0.00062 0.00063], DataType="single")

ECM_R0_D = Simulink.Parameter([0.00213 0.00209 0.00205 0.00197 0.00189 0.00176 0.00179 0.00176 0.00174 0.00173 0.00177 0.0018 0.00184 0.0018 0.00172 0.00174 0.00177 0.00183 0.00185 0.0019 0.00194
 0.00146 0.0014 0.00134 0.00127 0.0012 0.00121 0.0012 0.0012 0.00118 0.00115 0.00118 0.00118 0.00119 0.00117 0.00113 0.00117 0.00117 0.00119 0.00121 0.00124 0.00126
 0.00098 0.00095 0.00091 0.00087 0.00082 0.00081 0.00082 0.00081 0.00081 0.0008 0.0008 0.00081 0.0008 0.00082 0.00084 0.00082 0.00082 0.00082 0.00082 0.00081 0.0008
 0.00068 0.00065 0.00064 0.00062 0.00061 0.00061 0.00062 0.0006 0.00059 0.0006 0.0006 0.0006 0.0006 0.00059 0.00059 0.00059 0.00059 0.0006 0.0006 0.0006 0.00061], DataType="single")

ECM_R1_C = Simulink.Parameter([0.00086 0.00084 0.00076 0.00076 0.00056 0.00054 0.00039 0.00064 0.0008 0.0008 0.00084 0.00084 0.00076 0.00072 0.00064 0.00047 0.00059 0.00059 0.00099 0.00086 0.00086
 0.00196 0.00121 0.0009 0.0009 0.00037 0.00033 0.00032 0.00062 0.00062 0.00061 0.00062 0.00058 0.00035 0.00056 0.00073 0.00074 0.00066 0.00017 0.00017 0.00045 0.00045
 0.00025 0.00025 0.00038 0.00066 0.00066 0.00028 0.0003 0.0003 0.00022 0.00022 0.00023 0.00028 0.00028 0.00028 0.00047 0.00047 0.00051 0.00059 0.00045 0.00033 0.00033
 0.00099 0.00034 0.00034 0.00034 0.00022 0.00022 0.00019 0.00021 0.00027 0.00031 0.00032 0.00036 0.00035 0.00028 0.00029 0.00044 0.00047 0.00059 0.0005 0.00029 0.00029], DataType="single")

ECM_R1_D = Simulink.Parameter([0.00113 0.00063 0.00045 0.00041 0.00041 0.0004 0.0004 0.00042 0.00049 0.00053 0.00053 0.00079 0.00058 0.00063 0.00061 0.00053 0.00053 0.00051 0.00054 0.00055 0.0008
 0.00161 0.00115 0.00096 0.00087 0.00055 0.0003 0.0003 0.00038 0.00034 0.00033 0.00034 0.00048 0.0009 0.0009 0.00042 0.00059 0.0006 0.00042 0.00042 0.00089 0.0009
 0.00086 0.00066 0.00055 0.0005 0.00031 0.00024 0.00024 0.00023 0.00028 0.00045 0.00045 0.00025 0.00045 0.00044 0.00036 0.0008 0.00066 0.00066 0.0007 0.00072 0.00073
 0.00055 0.00046 0.00042 0.0004 0.00042 0.00029 0.00036 0.00046 0.00048 0.00036 0.00036 0.00028 0.00031 0.00062 0.00068 0.00027 0.0003 0.0003 0.00026 0.00026 0.00045], DataType="single")

ECM_R2_C = Simulink.Parameter([0.00238 0.00206 0.00176 0.00156 0.0015 0.00147 0.00152 0.00173 0.00199 0.00214 0.00209 0.00193 0.00164 0.00165 0.00175 0.00185 0.00227 0.00266 0.00289 0.0018 0.00176
 0.0021 0.00146 0.0013 0.00124 0.00103 0.00104 0.00109 0.00119 0.00148 0.00168 0.00184 0.00149 0.00115 0.0011 0.00112 0.00133 0.00149 0.00131 0.00109 0.00088 0.00088
 0.00172 0.00107 0.00091 0.00089 0.00083 0.00083 0.00082 0.00091 0.00107 0.00128 0.00138 0.00089 0.00078 0.00079 0.00078 0.00086 0.00107 0.0014 0.00148 0.00088 0.00088
 0.00051 0.00073 0.0004 0.0004 0.00056 0.00057 0.00053 0.00057 0.00071 0.00087 0.00092 0.00055 0.00046 0.00052 0.00051 0.00051 0.00079 0.00121 0.00142 0.00089 0.00089], DataType="single")

ECM_R2_D = Simulink.Parameter([0.01493 0.00498 0.00249 0.00166 0.00169 0.00172 0.00163 0.00161 0.00151 0.0015 0.00158 0.00203 0.00203 0.00205 0.00211 0.00217 0.00198 0.00164 0.00164 0.00146 0.00146
 0.00869 0.0029 0.00161 0.00134 0.00137 0.00136 0.00129 0.00121 0.0011 0.00107 0.00108 0.00162 0.00165 0.00172 0.00178 0.00163 0.00142 0.00113 0.00111 0.00103 0.00097
 0.00246 0.00154 0.0011 0.00092 0.00096 0.00106 0.00104 0.00091 0.00076 0.00076 0.00087 0.00094 0.00141 0.00135 0.00112 0.00095 0.00082 0.00073 0.00067 0.00065 0.00061
 0.0013 0.00082 0.00068 0.00065 0.00066 0.00071 0.00071 0.0006 0.00046 0.00051 0.0006 0.00095 0.0009 0.00084 0.0007 0.00055 0.00049 0.00041 0.00039 0.00035 0.00023], DataType="single")

ECM_R3_C = Simulink.Parameter([0.00415 0.00223 0.00203 0.00121 0.00106 0.00105 0.00113 0.00126 0.00132 0.00183 0.00189 0.0016 0.00138 0.00148 0.00161 0.00194 0.00253 0.0026 0.00294 0.00239 0.00181
 0.00139 0.00139 0.00126 0.00085 0.00068 0.00069 0.00082 0.00085 0.00102 0.0012 0.00152 0.00126 0.00116 0.00114 0.00119 0.00138 0.00151 0.00159 0.00158 0.00126 0.00233
 0.00228 0.00065 0.00065 0.00061 0.00039 0.00041 0.00052 0.00052 0.00056 0.00069 0.00079 0.00073 0.00064 0.00066 0.00068 0.00088 0.00115 0.00114 0.00111 0.0014 0.00162
 0.00107 0.00138 0.00172 0.00132 0.00079 0.00067 0.00037 0.00034 0.00036 0.00041 0.00043 0.00076 0.00075 0.00048 0.00052 0.00084 0.00096 0.00143 0.0019 0.0019 0.00193], DataType="single")

ECM_R3_D = Simulink.Parameter([1.08481 0.10848 0.01085 0.00181 0.00242 0.00392 0.00237 0.00202 0.00141 0.00129 0.00132 0.00401 0.0065 0.00623 0.00301 0.00187 0.00138 0.00111 0.00089 0.00089 0.00089
 0.08984 0.01797 0.00359 0.0012 0.00176 0.00242 0.00169 0.00133 0.001 0.00094 0.00103 0.00297 0.00342 0.0025 0.00156 0.00113 0.00077 0.00073 0.00077 0.00065 0.00063
 0.00314 0.00157 0.00105 0.0008 0.0008 0.00101 0.00092 0.00067 0.00054 0.00048 0.00061 0.00071 0.00081 0.00085 0.00075 0.00054 0.00048 0.00046 0.00052 0.00042 0.00037
 0.00567 0.00315 0.00225 0.00204 0.00242 0.00163 0.00071 0.00057 0.00038 0.00035 0.00061 0.00075 0.00098 0.00068 0.00043 0.00044 0.00039 0.00038 0.0003 0.00025 7.0e-5], DataType="single")

ECM_SOC = Simulink.Parameter([0 0.05 0.1 0.15 0.2 0.25 0.3 0.35 0.4 0.45 0.5 0.55 0.6 0.65 0.7 0.75 0.8 0.85 0.9 0.95 1], DataType="single")
ECM_T = Simulink.Parameter([0; 10; 25; 45], DataType="single")