% Simulink data dictionary Estimators_Dictionary.sldd
% references Global_Parameters.sldd

SOC_Max = Simulink.Parameter(1, DataType="single")  % Maximum state of charge (SOC)
SOC_Min = Simulink.Parameter(0, DataType="single")  % Minimum state of charge (SOC)
T_In = Simulink.Parameter(298.15, DataType="single", Unit="K")  % Initial temperature of the cell
T_Max = Simulink.Parameter(353.15, DataType="single", Unit="K")  % Maximum temperature of the cell
T_Min = Simulink.Parameter(263.15, DataType="single", Unit="K")  % Minimum temperature of the cell
Capacity_Vec = Simulink.Parameter([4.465 4.465 4.465 4.465], DataType="single")
NumberSt = Simulink.Parameter(4, DataType="single")
SOC_Vec1 = Simulink.Parameter([0; 0.01; 0.02; 0.03; 0.04; 0.05; 0.06; 0.07; 0.08; 0.09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 1], DataType="single")
SOC_Vec2 = Simulink.Parameter([0.04262832; 0.09049681; 0.1383648; 0.1862329; 0.2341007; 0.2819695; 0.3298375; 0.3777075; 0.4255772; 0.4734453; 0.5213135; 0.5691824; 0.6170521; 0.6649205; 0.7127891; 0.7606571; 0.8085252; 0.856394; 0.9042622; 0.9521303; 1], DataType="single")
SOH_Vec = Simulink.Parameter([0.8 0.85 0.9 0.95 1], DataType="single")
Temperature_Vec = Simulink.Parameter([273.15 283.15 298.15 318.15], DataType="single")
MaxChargeCurrent = Simulink.Parameter(-4.5, DataType="single")
MaxDischargeCurrent = Simulink.Parameter(13.5, DataType="single")
C1_Matrix = Simulink.Parameter(reshape([422.2404 832.5359 593.8369 100.0001 100.0001 100.0035 573.6834 595.7976 100.0005 100.0001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], 20, 7, 4), DataType="single")
C2_Matrix = Simulink.Parameter(reshape([1869.02 2837.237 2101.483 1494.004 1387.796 1517.454 2616.211 2389.814 1452.892 1228.797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], 20, 7, 4), DataType="single")
C3_Matrix = Simulink.Parameter(reshape([10000 10000.44 10000 1000000 1000000 10000 10006.05 10005.49 10000 1000000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], 20, 7, 4), DataType="single")
R0_Matrix = Simulink.Parameter(reshape([0.078 0.065280058 0.057635214 0.051424984 0.047235164 0.045274346 0.044600944 0.044414272 0.043883424 0.043849968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], 21, 4, 5), DataType="single")
R1_Matrix = Simulink.Parameter(reshape([0.008888958 0.01113245 0.004702087 0.00383287 0.004033211 0.00424596 0.007955655 0.007720292 0.004245837 0.003738035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], 20, 7, 4), DataType="single")
R2_Matrix = Simulink.Parameter(reshape([0.01999984 0.01853016 0.02 0.02 0.01909458 0.02 0.01757485 0.01812243 0.02 0.01763054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], 20, 7, 4), DataType="single")
R3_Matrix = Simulink.Parameter(reshape([0.01100056 0.005713594 0.009984016 0.001 0.001 0.00112775 0.002355572 0.002054581 0.001156752 0.001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], 20, 7, 4), DataType="single")
OCV_Matrix = Simulink.Parameter(reshape([2.499880511 2.757887899 2.885852779 2.958886734 3.012482188 3.054053996 3.088246035 3.118484978 3.146762309 3.174638012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], 61, 4, 5), DataType="single")
Current_Vec = Simulink.Parameter([0.2 0.5 1 3 5 7 10], DataType="single")
RC_SOC_Vec = Simulink.Parameter([0.05; 0.1; 0.15; 0.2; 0.25; 0.3; 0.35; 0.4; 0.45; 0.5; 0.55; 0.6; 0.65; 0.7; 0.75; 0.8; 0.85; 0.9; 0.95; 1], DataType="single")
V1_Max = Simulink.Parameter(0.01, DataType="single", Unit="V")  % Maximum voltage drop in 1º-RC branch
V1_Min = Simulink.Parameter(-0.01, DataType="single", Unit="V")  % Minimum voltage drop in 1º-RC branch
V2_Max = Simulink.Parameter(0.01, DataType="single", Unit="V")  % Maximum voltage drop in 2º-RC branch
V2_Min = Simulink.Parameter(-0.01, DataType="single", Unit="V")  % Minimum voltage drop in 2º-RC branch
V3_Max = Simulink.Parameter(0.01, DataType="single", Unit="V")  % Maximum voltage drop in 3º-RC branch
V3_Min = Simulink.Parameter(-0.01, DataType="single", Unit="V")  % Minimum voltage drop in 3º-RC branch
OCV_25 = Simulink.Parameter([2.499931353; 2.660173565; 2.770290801; 2.849668545; 2.910864288; 2.961377818; 3.004426237; 3.041700228; 3.074206823; 3.103359053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 4.199127613], DataType="single")
SOC_In = Simulink.Parameter(1, DataType="single")  % Initial state of charge (SOC)
L_SOP = Simulink.Parameter(10, DataType="single")
Ts_SOP = Simulink.Parameter(15)
Process_Noise_Covariance = Simulink.Parameter([1.0e-16; 1.0e-7; 1.0e-7; 1.0e-7], DataType="single")
Measurement_Noise_Covariance = Simulink.Parameter([0.0001; 0.0001; 0.0001; 0.0001], DataType="single")
Initial_Covariance = Simulink.Parameter([0; 0; 0; 0], DataType="single")