% Simulink data dictionary Global_Parameters.sldd

NumSeries = Simulink.Parameter(24, DataType="single")
Vmin = Simulink.Parameter(3, DataType="single")
Ts = Simulink.Parameter(0.01, Unit="s")  % Sample Time
NumParallel = Simulink.Parameter(30, DataType="single")
NumModules = Simulink.Parameter(1, DataType="single")
Vmax = Simulink.Parameter(4.1, DataType="single")